# Grasshopper definition 3d lsystem.gh (Grasshopper 1.0.7)
# plug-ins: Anemone, gHowl

# ---- group: Rewriting
N = Slider(3, range=1..8)
panel = Panel("FF-[-F+DFD+F]+[+FU-F-DDF]U[-DF+UF-DF]D[D+UF-UF]")
subtraction = Subtraction(A=N, B="1")
loop_start = LoopStart(Repeat=subtraction, Trigger=["F", "X", "F", subtraction, panel], Data_0="F")  # -> port, Counter, Data_0
rep = ReplaceString(String=loop_start.Data_0, Find="X", Replace="F", RecursiveReplace=False)
rep_2 = ReplaceString(String=rep, Find="F", Replace=panel, RecursiveReplace=False)
loop_paused = LoopPaused(port=loop_start.port, Exit=False, Data_0=flatten(rep_2), pausedState=True, state="Output last")  # disabled

# ----
len = StringLength(String=loop_paused)
subtraction_2 = Subtraction(A=len, B="1")
xz = XZPlane(Origin=Point(0, 0, 0))
rad = Radians(Degrees=Slider(25.7, range=0..100))
loop_start_2 = LoopStart(Repeat=subtraction_2, Trigger=loop_paused, Data_0=xz, Data_2=xz)  # -> port, Counter, Data_0, Data_1, Data_2
angle = Panel(rad)
substr = SubString(String=loop_paused, Start=loop_start_2.Counter, Count="1")
panel_2 = Panel("""F
f
+
-
[
]
U
D
X""")
clean = CleanTree(Data=loop_start_2.Data_2, CleanInvalid=True, CleanEmpty=False)
geo = Geometry(loop_start_2.Data_0)
pcomp = PlaneComponents(Plane=loop_start_2.Data_0)  # -> Origin, XAxis, YAxis, ZAxis
sdist = StringDistance(StringA=substr, StringB=panel_2, Case=True)
panel_3 = Panel(subtraction_2)
panel_4 = Panel(loop_start_2.Counter)
panel_5 = Panel("""0
1
2
3
4
5
6
7
8""")
pl = Plane(Origin=pcomp.Origin, XAxis=pcomp.XAxis, YAxis=pcomp.ZAxis)
pl_2 = Plane(Origin=pcomp.Origin, XAxis=pcomp.YAxis, YAxis=pcomp.ZAxis)
cull = CullPattern(List=panel_5, CullPattern=invert(sdist))

# ---- group: stack / push
plane = Geometry(loop_start_2.Data_0)
stack = Geometry(clean)
merge = Merge(Data1=stack, Data2=plane)

# ----
rotate = Rotate(Geometry=loop_start_2.Data_0, Angle=expr("-x", angle), Plane=pl)  # -> Geometry, Transform

# ---- group: D
rotate_2 = Rotate(Geometry=loop_start_2.Data_0, Angle=expr("-x", angle), Plane=pl_2)  # -> Geometry, Transform

# ---- group: pop
item = ListItem(List=reverse(clean), Index=0, Wrap=False)

# ---- group: F
move = Move(Geometry=loop_start_2.Data_0, Motion=pcomp.ZAxis)  # -> Geometry, Transform

# ---- group: f
move_2 = Move(Geometry=loop_start_2.Data_0, Motion=pcomp.ZAxis)  # -> Geometry, Transform

# ----
rotate_3 = Rotate(Geometry=loop_start_2.Data_0, Angle=angle, Plane=pl)  # -> Geometry, Transform

# ---- group: U
rotate_4 = Rotate(Geometry=loop_start_2.Data_0, Angle=angle, Plane=pl_2)  # -> Geometry, Transform

# ---- group: stack / pop
shift = ShiftList(List=reverse(stack), Shift=1, Wrap=False)  # -> reverse(List)

# ---- group: stack
instr = Integer(cull)
filter = StreamFilter(
    Gate=instr,
    Stream0=stack,
    Stream1=stack,
    Stream2=stack,
    Stream3=stack,
    Stream4=merge,
    Stream5=shift,
    Stream6=stack,
    Stream7=stack,
    Stream8=stack)

# ---- group: plane process
filter_2 = StreamFilter(
    Gate=cull,
    Stream0=move.Geometry,
    Stream1=move_2.Geometry,
    Stream2=rotate_3.Geometry,
    Stream3=rotate.Geometry,
    Stream4=loop_start_2.Data_0,
    Stream5=item,
    Stream6=rotate_4.Geometry,
    Stream7=rotate_2.Geometry,
    Stream8=loop_start_2.Data_0)

# ----
geo_2 = Geometry([Line((0, 0, 0), (0, -1, 0)), Line((0, -1, 0), (0, -2, 0)), Line((0, -2, 0), (0.7815209494, -2.623878999, 0)), Line((0.7815209494, -2.623878999, 0), (1.172281424, -3.435818499, 0.433659429)), Line((1.172281424, -3.435818499, 0.433659429), (1.025308203, -4.130431002, 1.137869869)), Line((0, -2, 0), (-0.433659429, -2.901076856, 0))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])
end = EndPoints(Curve=geo_2)  # -> Start, End
geo_3 = Geometry([Line((0, 0, 0), (0, -1, 0)), Line((0, -1, 0), (0, -2, 0)), Line((0, -2, 0), (0.7815209494, -2.623878999, 0)), Line((0.7815209494, -2.623878999, 0), (1.172281424, -3.435818499, 0.433659429)), Line((1.172281424, -3.435818499, 0.433659429), (1.025308203, -4.130431002, 1.137869869)), Line((0, -2, 0), (-0.433659429, -2.901076856, 0))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])
rep_3 = ReplaceText(Text=end.Start, Find="}", Replace="]", RecursiveReplace=False)
rep_4 = ReplaceText(Text=end.End, Find="}", Replace="]", RecursiveReplace=False)
rep_5 = ReplaceText(Text=rep_3, Find="{", Replace="[", RecursiveReplace=False)
rep_6 = ReplaceText(Text=rep_4, Find="{", Replace="[", RecursiveReplace=False)
panel_6 = Panel("""[[2.0,3,5,5.5]]
[[3.0,3,5,5.7]]""")
clean_2 = CleanTree(RemoveNulls=True, RemoveInvalid=True, RemoveEmpty=False, Tree=rep_5)
clean_3 = CleanTree(RemoveNulls=True, RemoveInvalid=True, RemoveEmpty=False, Tree=rep_6)
concat = Concatenate(FragmentA="[", FragmentB=clean_2, FragmentC=",", FragmentD=clean_3, FragmentE="]")
panel_7 = Panel(concat)
c_script = CSharpScript(data=concat)  # -> out, A; inputs data: list of String
# ---------- c_script: C# usings ----------
using System.Linq;
# ---------- c_script: C# ----------
    A = (data.Aggregate((i, j) => i + "," + j));
# ---------- end c_script ----------
port = Panel("9090")
concat_2 = Concatenate(FragmentA="{", FragmentB="'data':", FragmentG="[", FragmentC=c_script.A, FragmentD="]", FragmentH="}")
timer = Timer(TimerInterval=1000, Target=udp)
udp = UDPSender(Address="127.0.0.1", Port=port, Pattern=0, Data=concat_2)
panel_8 = Panel(concat_2)

lines = Geometry(loop_start_2.Data_1)

# ---- group: lines
line = LineSDL(Start=pcomp.Origin, Direction=pcomp.ZAxis, Length=1)
merge_2 = Merge(Data1=lines, Data2=line)

# ----
filter_3 = StreamFilter(
    Gate=cull,
    Stream0=merge_2,
    Stream1=lines,
    Stream2=lines,
    Stream3=lines,
    Stream4=lines,
    Stream5=lines,
    Stream6=lines,
    Stream7=lines,
    Stream8=lines)

running = Running(
    port=loop_start_2.port,
    Exit=False,
    Data_0=flatten(filter_2),
    Data_1=flatten(filter_3),
    Data_2=flatten(filter),
    pausedState=False,
    state="Constant output")  # -> Data_0, Data_1, Data_2
